# Grasshopper definition RhinoInsideUnity.gh (Grasshopper 1.0.7)

c_script = CSharpScript()  # -> out, A
# ---------- c_script: C# ----------
    Register(Component);
    A = pt;
# ---------- c_script: C# additional code ----------
  Point pt = null;
  bool registered = false;
  IGH_Component comp = null;

  void Register(IGH_Component component)
  {
    if(!registered)
    {
      Rhino.Runtime.HostUtils.RegisterNamedCallback("ToGrasshopper", ToGrasshopper);

      comp = component;

      registered = true;
    }
  }

  void ToGrasshopper(object sender, Rhino.Runtime.NamedParametersEventArgs args)
  {
    Rhino.Geometry.GeometryBase[] values;
    if (args.TryGetGeometry("point", out values))
      pt = values[0] as Rhino.Geometry.Point;

    comp.ExpireSolution(true);
  }
# ---------- end c_script ----------
panel = Panel(c_script.A)
pdecon = Deconstruct(Point=c_script.A)  # -> XComponent, YComponent, ZComponent
pt = ConstructPoint(XCoordinate=Slider(0, range=0..1), YCoordinate=Slider(0.18, range=0..1), ZCoordinate=Slider(0, range=0..1))
multiplication = Multiplication(A=pdecon.XComponent, B=Slider(6, range=0..10))
addition = Addition(A=multiplication, B=Slider(0.1, range=0..0.1))
msphere = MeshSphere(Base=pt, Radius=expr("x/50", addition), UCount=10, VCount=20)
unitymesh = UnityMesh(meshes=simplify(msphere), mats=simplify(ColourSwatch(SwatchColor=RGB(255, 255, 255))))  # -> outMesh, outMat; inputs meshes: tree of Mesh, mats: tree
# ---------- unitymesh: C# usings ----------
using System.Linq;
using System.Drawing;
using Grasshopper.GUI.Canvas;
# ---------- unitymesh: C# ----------
    if(comp == null){
      Component.PingDocument -= OnPingDocument;
      Component.PingDocument += OnPingDocument;
      Component.ObjectChanged -= OnObjectChanged;
      Component.ObjectChanged += OnObjectChanged;
      Grasshopper.Instances.ActiveCanvas.DocumentChanged -= OnDocumentChanged;
      Grasshopper.Instances.ActiveCanvas.DocumentChanged += OnDocumentChanged;

      comp = Component;
    }
    prevMeshes = meshes;

    DataTree<GH_Material> ghMats = new DataTree<GH_Material>();
    ClearAllMeshes(meshes);

    List <int> tempDataTreeCounts = new List<int>();
    for(int i = 0; i < meshes.BranchCount; i++){
      GH_Path path = meshes.Paths[i];
      tempDataTreeCounts.Add(meshes.Branches[i].Count);

      List<object> matList = mats.Branches[Math.Min(i, mats.BranchCount - 1)];
      for(int n = 0; n < meshes.Branches[i].Count; n++){
        Mesh mesh = meshes.Branches[i][n];
        object mat = matList[Math.Min(n, matList.Count - 1)];
        using(var args = new Rhino.Runtime.NamedParametersEventArgs())
        {
          Color color = Color.White;
          Color emission = Color.Black;
          Color specular = Color.DarkGray;
          double transparency = 0f;
          double shine = 50;


          if(mat != null && mat.GetType() == typeof(Rhino.Display.DisplayMaterial)){
            var material = (Rhino.Display.DisplayMaterial) mat;
            color = material.Diffuse;
            emission = material.Emission;
            transparency = material.Transparency;
            shine = material.Shine;
            specular = material.Specular;
          }else if(mat != null && mat.GetType() == typeof(System.Drawing.Color)){
            color = (System.Drawing.Color) mat;
            shine = 0.5;
          }

          args.Set("id", Component.InstanceGuid.ToString() + "-" + i.ToString() + "_" + n.ToString());
          args.Set("mesh", new Mesh[]{mesh});
          args.Set("diffuse", color);
          args.Set("emission", emission);
          args.Set("specular", specular);
          args.Set("transparency", transparency);
          args.Set("shine", shine);
          Rhino.Runtime.HostUtils.ExecuteNamedCallback("FromGHMesh", args);

          var displayMat = new Rhino.Display.DisplayMaterial(color);
          displayMat.Specular = specular;
          displayMat.Emission = emission;
          displayMat.Transparency = transparency;
          displayMat.Shine = shine;

          var ghmat = new GH_Material(displayMat);
          ghMats.Add(ghmat, path);
        }
      }
    }

    prevDataTreeCounts = tempDataTreeCounts;

    outMesh = meshes;
    outMat = ghMats;
# ---------- unitymesh: C# additional code ----------
  IGH_Component comp = null;
  DataTree<Mesh> prevMeshes = new DataTree<Mesh>();
  List<int> prevDataTreeCounts = new List<int>();

  public void OnPingDocument(object sender, GH_PingDocumentEventArgs e){
    if(e.Document == null){
      ClearAllMeshes(prevMeshes);
    }
  }

  public void OnObjectChanged(object sender, GH_ObjectChangedEventArgs e){
    if(e.Type == GH_ObjectEventType.Enabled){
      if(comp.Locked){
        ClearAllMeshes(prevMeshes);
      }
    }

    comp.ExpireSolution(true);
  }

  public void OnDocumentChanged(object sender, GH_CanvasDocumentChangedEventArgs e){
    ClearAllMeshes(prevMeshes);
    if(comp != null){
      comp.ExpireSolution(true);
    }
  }

  public void ClearAllMeshes(DataTree<Mesh> meshes){
    int branchCount = Math.Max(meshes.BranchCount, prevDataTreeCounts.Count);
    for(int i = 0; i < branchCount; i++){
      int meshCount = 0;
      int prevCount = 0;
      if(meshes.BranchCount > i){
        meshCount = meshes.Branches[i].Count;
      }
      if(prevDataTreeCounts.Count > i){
        prevCount = prevDataTreeCounts[i];
      }
      int itemCount = Math.Max(meshCount, prevCount);


      for(int n = 0; n < itemCount; n++){
        using(var args = new Rhino.Runtime.NamedParametersEventArgs()){
          args.Set("id", comp.InstanceGuid.ToString() + "-" + i.ToString() + "_" + n.ToString());
          Rhino.Runtime.HostUtils.ExecuteNamedCallback("FromGHClearMesh", args);
        }
      }
    }
  }
# ---------- end unitymesh ----------
